# Grasshopper definition Canopy.gh (Grasshopper 1.0.8)
# plug-ins: RhinoCodePluginGH, DendroGH

srf = Surface(<surface referenced from the Rhino model>)

# ----
# Canopy
crv = Curve([<curve referenced from the Rhino model> x4])
item = ListItem(List=crv, Index=0, Wrap=True)  # -> Item, Item1, Item2, Item3
edgesrf = EdgeSurface(CurveA=item.Item, CurveB=item.Item1, CurveC=item.Item3, CurveD=item.Item2)

# ----
# Tree B
pt = Point(<point referenced from the Rhino model>)
py3 = Python3Script(x=pt)  # -> out, branches, end_points
# ---------- py3: Python ----------
import rhinoscriptsyntax as rs
import random

def create_branch(start_point, direction, level, angle_range, length_range, max_levels, target_height):
    """
    Recursively creates branches.

    Args:
        start_point (tuple): Starting point of the branch.
        direction (tuple): Direction vector of the branch.
        level (int): Current level of branching.
        angle_range (tuple): Minimum and maximum angle for branching.
        length_range (tuple): Minimum and maximum length for branches.
        max_levels (int): Maximum depth of branching.
        target_height (float): Approximate height where the branches should end.

    Returns:
        tuple: A tuple containing a list of branch lines and a list of end points of the last level branches.
    """
    if level > max_levels:
        # Adjust endpoint height to be closer to the target height
        adjusted_point = (start_point[0], start_point[1], target_height + random.uniform(-1.0, 1.0))
        return ([], [adjusted_point])

    branches = []
    end_points = []

    # Generate a random length for the branch
    branch_length = random.uniform(*length_range)

    # Calculate the endpoint of the branch
    end_point = rs.PointAdd(start_point, rs.VectorScale(direction, branch_length))

    # Store the branch as a line
    branches.append(rs.AddLine(start_point, end_point))

    # Generate child branches
    num_branches = random.randint(2, 3)  # Randomly choose 2 or 3 child branches
    for _ in range(num_branches):
        # Create a random direction by perturbing the current direction
        angle = random.uniform(*angle_range)
        axis = (
            random.uniform(-1, 1),
            random.uniform(-1, 1),
            random.uniform(-1, 1)
        )  # Random rotation axis
        axis = rs.VectorUnitize(axis)
        rotated_direction = rs.VectorRotate(direction, angle, axis)

        # Ensure the tree grows more naturally in 3D
        rotation = rs.VectorAdd(rotated_direction, direction)
        rotation = rs.VectorUnitize(rotation)

        # Recursively create child branches
        child_branches, child_end_points = create_branch(end_point, rotation, level + 1, angle_range, length_range, max_levels, target_height)
        branches.extend(child_branches)
        end_points.extend(child_end_points)

    return (branches, end_points)

# Parameters
start_point = x  # Input starting point
initial_direction = (0, 0, 1)  # Start growing upwards
angle_range = (-45, 45)  # Wider angle range for 3D growth
length_range = (2.0, 5.0)  # Length range for branches
max_levels = 5  # Depth of the tree
target_height = 20.0  # Target height for the endpoints

# Generate the tree structure
branches, last_level_end_points = create_branch(start_point, initial_direction, 1, angle_range, length_range, max_levels, target_height)

# Output the branches as lines and the end points of the last level
a = branches
b = last_level_end_points
# ---------- end py3 ----------

# ----
# Tree A
pt_2 = Point(<point referenced from the Rhino model>)
py3_2 = Python3Script(x=pt_2)  # -> out, branches, end_points; same code as py3

crv_2 = Curve([py3_2.branches, py3.branches])
len = Length(Curve=crv_2)
explode = Explode(Curve=crv_2, Recursive=True)  # -> Segments, graft(Vertices)
division = Division(A=len, B=Slider(2, range=0..10))
popgeo = PopulateGeometry(Geometry=edgesrf, Count=Slider(4, range=0..10), Seed=Slider(2, range=0..10))
divide = DivideCurve(Curve=crv_2, Count=division, Kinks=False)  # -> flatten(Points), Tangents, Parameters
pdecon = Deconstruct(Point=divide.Points)  # -> XComponent, YComponent, ZComponent
number_slider = Slider(0.26, range=0..1)
bnd = Bounds(Numbers=pdecon.ZComponent)
bnd_2 = Bounds(Numbers=explode.Segments)
dom = ConstructDomain(DomainStart=Slider(1, range=0..1), DomainEnd=Slider(0.55, range=0..1))
dom_2 = ConstructDomain(DomainStart=Slider(1, range=0..1), DomainEnd=Slider(0.3, range=0..1))
remap = RemapNumbers(Value=pdecon.ZComponent, Source=bnd, Target=dom)  # -> Mapped, Clipped
remap_2 = RemapNumbers(Value=explode.Vertices, Source=bnd_2, Target=dom_2)  # -> Mapped, Clipped
vsettings = CreateSettings(VoxelSize=Slider(0.26, range=0..1), Bandwidth=1, Isovalue=0, Adaptivity=0.1)
vpoints = PointsToVolume(Points=divide.Points, PointRadius=remap.Mapped, Settings=vsettings)
vcurve = CurveToVolume(Curves=crv_2, CurveRadius=remap_2.Mapped, Settings=vsettings)  # -> flatten(Volume)
vunion = VolumeUnion(Volumes=[vpoints, vcurve])  # -> flatten(Result)
vsmooth = SmoothVolume(Volume=vunion, Width=1, Type=Slider(0, range=0..3), Iterations=1)
